% Simulink data dictionary DrivetrainHevMmDD.sldd

DiffRatio = 3.421
EngDriveRatio = 0.8130081
Jengine = 0.22
MotGbRatio = 2.45
RWheel = 0.3
b_axle = Simulink.Parameter(10)
b_driveshaft = Simulink.Parameter(10)
k_axle = Simulink.Parameter(5000)
k_driveshaft = Simulink.Parameter(1000)
wc_shaft = Simulink.Parameter(1000)